# Requirement set AUVreq (R2023b)
The system shall autonomously scan underwater pipelines

## 1 [MSN] Mission
The system shall autonomously scan underwater pipelines

### 1.1 [STK-RQM] Stakeholder Requirements
The system shall meet the requirements of stakeholders

#### 1.1.1 [MNT] Maintanance
the system shall provide the technician with maintenance possibility

##### 1.1.1.1 [DIS] Disassembly
The system shall use screw connections to provide disassembly option

##### 1.1.1.2 [RPLC] Replacement
Inner components shall be accessible from the body interior for replacement

#### 1.1.2 [ENV] Environment
The system shall be environmental friendly

##### 1.1.2.1 [CLR] Color
The system shall use water proof colors

##### 1.1.2.2 [NS] Noise
The system shall use low-noise motors

##### 1.1.2.3 [LKG] Leakage
The system shall use a cover for the battery pack to avoid accidental leakages

### 1.2 [DT-CMN] Data Communication
The system shall communicate with the landstation

#### 1.2.1 [TR] Send
The system shall send data to the land station with 1 Hz frequency

##### 1.2.1.1 [PCKG] Data Packing
The system shall prepare a packed log file of each pipeline section scan

##### 1.2.1.2 [ENC] Encryption
The system shall encrypt diagnosis data before sending to the land station

#### 1.2.2 [RC] Receive
The system shall receive the land station commands with a maximum 0.5 second delay

##### 1.2.2.1 [DEC] Decryption
The system shall decrypt the mission message coming from the land station.

### 1.3 [LCL] Localization
The system shall determine its global location

#### 1.3.1 [SDI] Sensor Data Integration
The system shall perform data integration to find its pose configuration with less than 1m uncertainity

##### 1.3.1.1 [IMU-SEP] IMU Seperator
The system shall separate IMU measurements based on their units

###### 1.3.1.1.1 [IMU] Angular Rate measurement
The system shall obtain gyroscope data with 100Hz

##### 1.3.1.2 [GNSS-SEP] NMEA Seperator
The system shall obtain 3 positions' values from the NMEA message

###### 1.3.1.2.1 [GNSS] WGS84 Pose
The system shall obtain its position in WGS84 coordinates with 1Hz

### 1.4 [PLN] Motion Planning
The system shall plan a trajectory for the mission coming from the landstation

#### 1.4.1 [Xi] Mission Xi
The system shall receive the initial state of the mission

#### 1.4.2 [Xf] mission Xf
The system shall receive the final state of the mission

### 1.5 [DGN] Diagnosis
The system shall be able to find problems in the pipeline

#### 1.5.1 [OBJ-DET] Pipe Detection
the system shall detect the presence of pipe in the camera frame

##### 1.5.1.1 [PG] photography
the system shall start photography with 1 Hz when its distance with pipeline is less than 1 meter

#### 1.5.2 [SEM-SEG] Fault Detection
The system shall perform fault detection on X-ray scans

##### 1.5.2.1 [RG] Radiography
The system shall start radiography with 1 Hz when its distance with pipeline is less than 1 Hz

### 1.6 [CTRL] Motion Control
The system shall move on the planned trajectory

#### 1.6.1 [R1] Motor 1 R
The Motor 1 shall rotate in the planned RPM

##### 1.6.1.1 [C1] Motor C1
The system shall send the control input to motor 1

#### 1.6.2 [R2] Motor 2 R
The Motor 2 shall rotate in the planned RPM

##### 1.6.2.1 [C2] Motor C2
The system shall send the control input to motor 2

#### 1.6.3 [R3] Motor 3 R
The Motor 3 shall rotate in the planned RPM

##### 1.6.3.1 [C3] Motor C3
The system shall send the control input to motor 3

#### 1.6.4 [R4] Motor 4 R
The Motor 4 shall rotate in the planned RPM

##### 1.6.4.1 [C4] Motor C4
The system shall send the control input to motor 4

### 1.7 [SFT] Safety
The system shall have a safe mission

#### 1.7.1 [PR] Pressure Resistance
The system shall resist pressure up to 1.5 Atm

#### 1.7.2 [WR] Water resistance
The system shall be water proof for up to 10 hourse

#### 1.7.3 [SHP] Shark Pulse
The system shall send pulses with a frequency of 0.1 Hz to keep large animals away

#### 1.7.4 [SNT] Salinity Resistance
The system shall be protected against salinity

### 1.8 [RSRC] Resources
The system shall store energy and data

#### 1.8.1 [CHRG] Battery Capacity
The system shall store energy for up to 10 hours of operation

#### 1.8.2 [SOS] Emergency Mission End
The system shall stop the mission when the battery SOC is less than 12%

##### 1.8.2.1 [#51] SOC Calculator
The system shall determine the SOC of the battery

#### 1.8.3 [STRG-DTC] Pipe Detection Data
The system shall be able to store Trained Pipe Detection Model

#### 1.8.4 [STRG-FLT] Fault Detection Data
The system shall be able to store Trained Fault Detection Model