test file "test1"

suite "New Test Suite 1"

  case "CommTestDec" [simulation]
    model Arduino
    assessment "Assessment1": At any point of time, whenever p == 1 is true then, with no delay, q ~= -1 & q ~= -1000 must be true
      p: signal Arduino/Demux, port 1
      q: signal Arduino/Demux1, port 1

  case "CommTestEnc" [simulation]
    model Arduino
    assessment "Assessment1": At any point of time, e==12 must be true
      e: signal Arduino/Demux2, port 1

  case "CommLog" [simulation]
    model Arduino
    assessment "Assessment1": At any point of time, l == 9 must be true
      l: signal Arduino/MATLAB Function3, port 1

  case "NMEAsep" [simulation]
    model IntegratedLocalizationProcessor
    assessment "Assessment1" (off): At any point of time, p == 41 must be true
    assessment "Assessment2": At any point of time, whenever p == 41 is true then, with no delay, q == 3 must be true
      p: signal IntegratedLocalizationProcessor/Cast To Single, port 1
      q: signal IntegratedLocalizationProcessor/Cast To Single1, port 1

  case "IMUsep" [simulation]
    model IntegratedLocalizationProcessor
    assessment "Assessment1": At any point of time, whenever p == 0 is true then, with no delay, q == 0 must be true
      p: signal IntegratedLocalizationProcessor/Cast To Double2, port 1
      q: signal IntegratedLocalizationProcessor/Sum, port 1